# Grasshopper definition torsade.gh (Grasshopper 1.0.7)

xy_plane = XYPlane(Origin=Point(0, 0, 0))
number_slider = Slider(20, range=0..30)
circle = Circle(Plane=xy_plane, Radius=Slider(36, range=0..50))
range = Range(Domain=Slider(360, range=0..1000), Steps=number_slider)
perp_frames = PerpFrames(Curve=circle, Count=number_slider, Align=True)  # -> Frames, Parameters
cull_index = CullIndex(List=range, Indices=Slider(-1, range=-1..1), Wrap=True)
radians = Radians(Degrees=cull_index)
multiplication = Multiplication(A=Slider(8, range=0..10), B=radians)
rotate = Rotate(Geometry=perp_frames.Frames, Angle=multiplication, Plane=perp_frames.Frames)  # -> Geometry, Transform
polygon = Polygon(
    Plane=rotate.Geometry,
    Radius=Slider(10, range=0..10),
    Segments=Slider(8, range=0..10),
    FilletRadius=Slider(0.33, range=0..10))  # -> Polygon, Length
area = Area(Geometry=polygon.Polygon)  # -> Area, Centroid
point = Point(Point(0, 0, 0))
scale = Scale(Geometry=polygon.Polygon, Center=area.Centroid, Factor=0.5)  # -> Geometry, Transform
pull_point = PullPoint(Point=area.Centroid, Geometry=point, ClosestOnly=True)  # -> ClosestPoint, Distance
loft_options = LoftOptions(Closed=Toggle(True), Adjust=Toggle(False), Rebuild=Toggle(False), Refit=Toggle(False), Type=Toggle(False))
loft = Loft(Curves=scale.Geometry, Options=loft_options)
cap_holes = CapHoles(Brep=loft)
custom_preview = CustomPreview(Geometry=cap_holes, Material=ColourSwatch(SwatchColor=RGB(227, 25, 25)))
